# Grasshopper definition test codechecker.gh (Grasshopper 1.0.9)
# plug-ins: Karamba3D

crosec = CrossSectionKaramba3D(
    FamilyNameOfCrossSection="DefaultCroSec",
    Height_cm=10,
    UpperFlangeWidth_cm=5,
    LowerFlangeWidth_cm=5,
    UpperFlangeThickness_cm=0.4,
    LowerFlangeThickness_cm=0.4,
    SidewallsThickness_cm=0.4,
    FilletRadius_cm=0.6,
    mode="Box")
xy = XYPlane(Origin=Point(0, 0, 0))
X = UnitX(Factor="3")
line = LineSDL(Start=xy, Direction=X, Length="3")
move = Move(Geometry=line, Motion=X)  # -> Geometry, Transform
lineelem = CreateLinearElementKaramba3D(
    Line=flatten([line, move.Geometry]),
    CrossSection=crosec,
    LimitDistance_m=0.005,
    BucklingLengthY_m=-1,
    BucklingLengthZ_m=-1,
    BucklingLengthLT_m=-1,
    Bending=True,
    ToPolylineMaxAngle=0.25,
    ToPolylineTolerance=0.1,
    ToPolylineMaxEdgeLength=0.25,
    New=True,
    Remove=True,
    mode="LineToBeam",
    GuidGeneratorSeed=1231336578)  # -> Element, Points, Info
Z = UnitZ(Factor=-1)
end = EndPoints(Curve=line)  # -> Start, End
Z_2 = UnitZ(Factor=-1)
lccombinator = LoadCaseCombinatorKaramba3D(LoadCaseCombinationRulesKaramba3D="ULS = (1.3|0.9)*DL+1.5*LL")  # -> LoadCaseCombinations, NamesOfLoadCases, NumberOfLoadCases
supp = SupportKaramba3D(PosInd=end.Start, Ct_kN_m=Vector(0, 0, 0), Cr_kNm_rad=Vector(0, 0, 0), menu=[buttons(on, on, on, off, off, off)])
supp_2 = SupportKaramba3D(PosInd=end.End, Ct_kN_m=Vector(0, 0, 0), Cr_kNm_rad=Vector(0, 0, 0), menu=[buttons(on, on, on, on, off, off)])
beam_loads = BeamLoadsKaramba3D(
    BeamIdentifier=lineelem.Element,
    LoadCase="DL",
    ForceVector=Z,
    TPosition="0.5",
    mode="Concentrated",
    menu=[buttons(on, off)])
beam_loads_2 = BeamLoadsKaramba3D(
    BeamIdentifier=lineelem.Element,
    LoadCase="LL",
    ForceVector=Z_2,
    TStart=0,
    TEnd=1,
    mode="Block",
    menu=[buttons(on, off, off)])
assemble = AssembleModelKaramba3D(
    Elem=lineelem.Element,
    Support=[supp, supp_2],
    Load=flatten([beam_loads_2, lccombinator.LoadCaseCombinations, beam_loads]),
    LimitDistance_m=0.005)  # -> Model, Info, Mass_kg, CentreOfGravity, LoadCaseNames
analyse = AnalyseKaramba3D(Model=assemble.Model)  # -> AnalysedModel, MaximumDisplacement_cm, ResultingForce_kN, ChangeOfElasticEnergy_kNm
b_forces = BeamForcesKaramba3D(Ts=[0, 1])  # -> Model, NormalForce_kN, ShearForceVz_kN, ShearForceVy_kN, TorsionalMomentMt_kNm, BendingMomentMy_kNm, BendingMomentMz_kNm, LoadCaseIndex
modelview = ModelViewKaramba3D()  # -> Model, DeformedMesh, DeformedAxes, DeformedModel, MaximumDeformation
py3 = Python3Script(Model=analyse.AnalysedModel, LCase="ULS", Beams_Ids="Default", n_positions="5")  # -> out; inputs LCase: list, Beams_Ids: String, n_positions: Int32
# ---------- py3: Python ----------
from karamba_helper import *
from code_checker import *

import Karamba.Models
import Karamba.Loads
import Karamba.Elements
import Karamba.Results
from System.Collections.Generic import List
from System import String

model = Model
lcName = LCase

all_sec = [extract_section_properties(sec) for sec in model.crosecs]
all_mat = [extract_material(mat) for mat in model.materials]
elem_info  = [extract_element_info(el) for el in model.elems]
sub_lcs    = expand_load_combinations(model, ['ULS'])
# forces_all = extract_element_forces(model, elem_ids, [n for n,_ in sub_lcs])

print(all_sec)
# ---------- end py3 ----------
disassemble = DisassembleMaterialKaramba3D()  # -> Material, TypeOfMaterial, FamilyNameOfMaterial, NameOfMaterial, ElemIdentifiers, Colour, YoungsModulusKNCm²Dir12, InPlaneShearModulus_kN_cm²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
panel = Panel(py3)
